# Grasshopper definition itm_L1_CZ1A.gh (Grasshopper 1.0.7)

opaquemat = HBOpaqueMaterial(
    name="flat Concrete Extrusions",
    thickness="0.68",
    conductivity="2.31",
    density="2322",
    spec_heat="832",
    roughness="MediumSmooth",
    therm_absp="0.9",
    sol_absp="0.7",
    vis_absp="0.7")  # -> mat; plug-in component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

searchmats = HBSearchMaterials(keywords="8 in. Normalweight Concrete Floor")  # -> opaque_mats, window_mats; plug-in component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

searchmats_2 = HBSearchMaterials(keywords="Typical Insulation R27")  # -> flatten(opaque_mats), window_mats; plug-in component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

opaquematnomass = HBOpaqueMaterialNoMass(
    name="Typical Insulation R-14.97",
    r_value="2.637230",
    roughness="Smooth",
    therm_absp="0.9",
    sol_absp="0.7",
    vis_absp="0.8")  # -> mat; plug-in component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

searchmats_3 = HBSearchMaterials(keywords="4 in. Normalweight Concrete Floor")  # -> flatten(opaque_mats), window_mats; plug-in component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

searchmats_4 = HBSearchMaterials(keywords="Typical Insulation R26")  # -> flatten(opaque_mats), window_mats; plug-in component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

searchmats_5 = HBSearchMaterials(keywords="Typical Insulation R11 ")  # -> opaque_mats, window_mats; plug-in component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

opaquematnomass_2 = HBOpaqueMaterialNoMass(
    name="Typical Insulation R-1.85",
    r_value="0.326262",
    roughness="Smooth",
    therm_absp="0.9",
    sol_absp="0.7",
    vis_absp="0.7")  # -> mat; plug-in component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

opaquematnomass_3 = HBOpaqueMaterialNoMass(
    name="Typical Insulation R-13.45",
    r_value="2.368000",
    roughness="Smooth",
    therm_absp="0.9",
    sol_absp="0.7",
    vis_absp="0.7")  # -> mat; plug-in component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

searchmats_6 = HBSearchMaterials(keywords="Typical Insulation-R3")  # -> flatten(opaque_mats), window_mats; plug-in component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
list_item = ListItem(List=searchmats_6.opaque_mats, Index=0, Wrap=True)

opaquemat_2 = HBOpaqueMaterial(
    name="100mm Normalweight Concrete floor",
    thickness="0.101600",
    conductivity="2.31",
    density="2322",
    spec_heat="832",
    roughness="MediumSmooth",
    therm_absp="0.9",
    sol_absp="0.7",
    vis_absp="0.7")  # -> mat; plug-in component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

opaquematnomass_4 = HBOpaqueMaterialNoMass(
    name="Typical Insulation R-30.13",
    r_value="5.306685",
    roughness="Smooth",
    therm_absp="0.9",
    sol_absp="0.7",
    vis_absp="0.7")  # -> mat; plug-in component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

# ---- group: Internal Mass
opaquemat_3 = HBOpaqueMaterial(
    name="Std Wood 6inch",
    thickness="0.15",
    conductivity="0.12",
    density="540",
    spec_heat="1210",
    roughness="MediumSmooth",
    therm_absp="0.9",
    sol_absp="0.7",
    vis_absp="0.7")  # -> mat; plug-in component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
opaqueconstr = HBOpaqueConstruction(name="InteriorFurnishings", materials=opaquemat_3)  # -> constr; plug-in component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

# ----
bldgvintages = HBBuildingVintages({"ASHRAE 90.1 2019  |  IECC 2021": "2019", "ASHRAE 90.1 2016  |  IECC 2018": "2016", "ASHRAE 90.1 2013  |  IECC 2015": "2013", "ASHRAE 90.1 2010  |  IECC 2012": "2010", "ASHRAE 90.1 2007  |  IECC 2009": "2007", "ASHRAE 90.1 2004  |  IECC 2006": "2004", "1980-2004 (CBECS)": "1980_2004", "Pre-1980 (CBECS)": "pre_1980"}, selected="ASHRAE 90.1 2016  |  IECC 2018")
constructiontypes = HBConstructionTypes({"SteelFramed", "WoodFramed", "Mass", "Metal Building"}, selected="SteelFramed")
constrsetclimate = HBConstructionSetByClimate(climate_zone="1A", vintage=bldgvintages, constr_type=constructiontypes)  # -> constr_set; plug-in component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
searchprog = HBSearchPrograms(vintage=bldgvintages, keywords="Whole")  # -> room_prog; plug-in component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

# ---- group: Input Plenum
rooms = Brep(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)

# ---- group: Input Rooms
rooms_2 = Brep(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)

# ---- group: Inteiror Walls
perimeter_thermal_zone_depth = Panel("4.572")
debrep = DeconstructBrep(Brep=rooms_2)  # -> Faces, Edges, Vertices
item = ListItem(List=debrep.Faces, Index=0, Wrap=True)  # -> Item, Item1, Item2
floor_to_ceiling_height = Panel("2.74")
skeleton = HBStraightSkeleton(floor_geo=item.Item, offset=perimeter_thermal_zone_depth)  # -> polyskel, perim_poly, core_poly; plug-in component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
lng = ListLength(List=flatten(skeleton.perim_poly))
lng_2 = ListLength(List=flatten(item.Item))
division = Division(A=lng, B=lng_2)
Z = UnitZ(Factor=floor_to_ceiling_height)
extr = Extrude(Base=skeleton.perim_poly, Direction=Z)
partition = PartitionList(List=extr, Size=division)
extr_2 = Extrude(Base=skeleton.core_poly, Direction=Z)  # -> graft(Extrusion)
partition_2 = PartitionList(List=skeleton.perim_poly, Size=division)
ins = InsertItems(List=partition, Item=extr_2, Indices=4, Wrap=True)

# ---- group: Boundary Condition
debrep_2 = DeconstructBrep(Brep=ins)  # -> Faces, Edges, Vertices
debrep_3 = DeconstructBrep(Brep=rooms)  # -> Faces, Edges, Vertices
panel = Panel("""1
4
7
10
13""")
item_2 = ListItem(List=debrep_2.Faces, Index=0, Wrap=True)
item_3 = ListItem(List=debrep_3.Faces, Index=panel, Wrap=True)
panel_2 = Panel("""Rm1_Wall_
Rm2_Wall_
Rm3_Wall_
Rm4_Wall_
Rm5_Wall_""")
face = HBFace(geo=flatten(item_2), name="ExposedFloor", bc="Adiabatic")  # -> report, graft(faces); plug-in component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
face_2 = HBFace(geo=debrep_2.Faces, name=graft(panel_2))  # -> report, faces; plug-in component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
face_3 = HBFace(geo=item_3, name="ExposedCeiling_", bc="Adiabatic")  # -> report, faces; plug-in component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
face_4 = HBFace(geo=debrep_3.Faces)  # -> report, faces; plug-in component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
replace = ReplaceItems(List=face_4.faces, Item=face_3.faces, Indices=panel, Wrap=False)
replace_2 = ReplaceItems(List=face_2.faces, Item=face.faces, Indices="0", Wrap=False)

# ----
decnstrconstrsetint = HBDeconstructConstructionSetInterior(constr_set=constrsetclimate)  # -> interior_wall, ceiling, interior_floor, interior_window, interior_door, int_glass_door; plug-in component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
searchmats_7 = HBSearchMaterials(keywords="carpet")  # -> opaque_mats, window_mats; plug-in component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
decnstrconstrset = HBDeconstructConstructionSet(constr_set=constrsetclimate)  # -> exterior_wall, exterior_roof, exposed_floor, ground_wall, ground_roof, ground_floor, window, skylight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; plug-in component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
searchprog_2 = HBSearchPrograms(vintage=bldgvintages, keywords="Plenum")  # -> room_prog; plug-in component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
panel_3 = Panel(searchprog)
panel_4 = Panel(searchprog_2)
item_4 = ListItem(List=searchprog_2, Index="0", Wrap=True)
item_5 = ListItem(List=searchprog, Index="3", Wrap=True)

# ---- group: Plenum Program
programtype = HBProgramType(name="plenum_prog")  # -> program; plug-in component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

# ----
panel_6 = Panel(item_5)
roomattr = HBRoomAttributes({"Display Name": "display_name", "Simulation Name (Identifier)": "identifier", "Multiplier": "multiplier", "Floor Area Excluded": "exclude_floor_area", "Story": "story", "Volume": "volume", "Gross Floor Area": "floor_area", "Exposed Area": "exposed_area", "Exterior Wall Area": "exterior_wall_area", "Exterior Aperture Area": "exterior_aperture_area", "Average Floor Elevation": "average_floor_height"}, selected="Display Name")
versions = HBCheckVersions()  # -> lbt_gh, python, radiance, openstudio, energyplus; plug-in component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

# ---- group: Room Program
deconstrprogram = HBDeconstructProgramType(program=item_5)  # -> people, lighting, electric_equip, gas_equip, hot_water, infiltration, ventilation, setpoint; plug-in component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
programtype_2 = HBProgramType(
    name="office_prog_perimeterRms",
    people=deconstrprogram.people,
    lighting=deconstrprogram.lighting,
    electric_equip=deconstrprogram.electric_equip,
    infiltration=deconstrprogram.infiltration,
    ventilation=deconstrprogram.ventilation,
    setpoint=deconstrprogram.setpoint)  # -> program; plug-in component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
programtype_3 = HBProgramType(
    name="office_prog_core",
    people=deconstrprogram.people,
    lighting=deconstrprogram.lighting,
    electric_equip=deconstrprogram.electric_equip,
    ventilation=deconstrprogram.ventilation,
    setpoint=deconstrprogram.setpoint)  # -> program; plug-in component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

# ----
toggle = BooleanToggle(False)  # disabled
toggle_2 = BooleanToggle(False)  # disabled
panel_7 = Panel("1.6.0")  # disabled
versioner = LBVersioner(update=toggle_2, version=panel_7)  # -> Vviiiiiz; disabled; plug-in component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
syncghfile = LBSyncGrasshopperFile(sync=toggle)  # -> report; disabled; plug-in component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
panel_8 = Panel(versions.openstudio)
panel_9 = Panel(versions.lbt_gh)
panel_10 = Panel(syncghfile)  # disabled
panel_11 = Panel("""0
0
0
0
0
0
0
0
0
0
0
0
0
0
0
0
0
0
0
0
0
0
0
0""")
panel_12 = Panel("""0
0
0
0
0
1
1
1
1
1
1
1
1
1
1
1
1
1
1
1
1
0
0
0""")
panel_13 = Panel("""0
0
0
0
0
1
1
1
1
1
1
1
1
1
1
1
1
1
0
0
0
0
0
0""")
panel_14 = Panel("""0
0
0
0
0
0
0
0
0
0
0
0
0
0
0
0
0
0
0
0
0
0
0
0""")
panel_15 = Panel("""0
0
0
0
0
1
1
1
1
1
1
1
1
1
1
1
1
1
1
1
1
0
0
0""")
panel_16 = Panel("""0
0
0
0
0
1
1
1
1
1
1
1
1
1
1
1
1
1
0
0
0
0
0
0""")
weeklyschedule = HBWeeklySchedule(
    sun=panel_14,
    mon=panel_15,
    tue=panel_15,
    wed=panel_15,
    thu=panel_15,
    fri=panel_15,
    sat=panel_16,
    holiday=panel_14,
    summer_des=panel_15,
    winter_des=panel_16,
    name="HVACOperatiion Schd",
    type_limit="On-Off")  # -> report, schedule, idf_year, idf_week, idf_days; plug-in component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
weeklyschedule_2 = HBWeeklySchedule(
    sun=panel_11,
    mon=panel_12,
    tue=panel_12,
    wed=panel_12,
    thu=panel_12,
    fri=panel_12,
    sat=panel_13,
    holiday=panel_11,
    summer_des=panel_12,
    winter_des=panel_13,
    name="Hours_of _operation",
    type_limit="Fractional")  # -> report, schedule, idf_year, idf_week, idf_days; plug-in component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
searchschs = HBSearchSchedules(keywords="Medium Office")  # -> schedules, type_limits; plug-in component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
panel_17 = Panel(searchschs.schedules)
panel_18 = Panel("""0.05
0.05
0.05
0.05
0.1
0.08623256
0.25869768
0.25869768
0.25869768
0.25869768
0.25869768
0.25869768
0.25869768
0.25869768
0.25869768
0.25869768
0.4311628
0.25869768
0.25869768
0.17246512
0.17246512
0.08623256
0.04311628
0.04311628""")
panel_19 = Panel("""0.05
0.05
0.05
0.05
0.05
0.08623256
0.08623256
0.25869768
0.25869768
0.25869768
0.25869768
0.12934884
0.12934884
0.12934884
0.12934884
0.12934884
0.04311628
0.04311628
0.05
0.05
0.05
0.05
0.05
0.05""")
panel_20 = Panel("""0.230755381
0.230755381
0.230755381
0.230755381
0.230755381
0.381234796
0.381234796
0.857778291
0.476543495
0.476543495
0.476543495
0.333580447
0.333580447
0.333580447
0.333580447
0.333580447
0.285926097
0.285926097
0.230755381
0.230755381
0.230755381
0.230755381
0.230755381
0.230755381""")
panel_21 = Panel("""0
0
0
0
0
0.05
0.05
0.05
0.05
0.05
0.05
0.05
0.05
0.05
0.05
0.05
0.05
0
0
0
0
0
0
0""")
panel_22 = Panel("""0
0
0
0
0
1
1
1
1
1
1
1
1
1
1
1
1
1
1
1
1
0.05
0.05
0.05""")
panel_23 = Panel("""0.05
0.05
0.05
0.05
0.05
0.04311628
0.04311628
0.04311628
0.04311628
0.04311628
0.04311628
0.04311628
0.04311628
0.04311628
0.04311628
0.04311628
0.04311628
0.05
0.05
0.05
0.05
0.05
0.05
0.05""")
panel_24 = Panel("""1
1
1
1
1
1
1
1
1
1
1
1
1
1
1
1
1
1
1
1
1
1
1
1""")
panel_25 = Panel("""0
0
0
0
0
0
0
0
0
0
0
0
0
0
0
0
0
0
0
0
0
0
0
0""")
panel_26 = Panel("""0.230755381
0.230755381
0.230755381
0.230755381
0.230755381
0.285926097
0.285926097
0.285926097
0.285926097
0.285926097
0.285926097
0.285926097
0.285926097
0.285926097
0.285926097
0.285926097
0.285926097
0.230755381
0.230755381
0.230755381
0.230755381
0.230755381
0.230755381
0.230755381""")
panel_27 = Panel("""0.307673841
0.307673841
0.307673841
0.307673841
0.307673841
0.381234796
0.381234796
0.857778291
0.857778291
0.857778291
0.857778291
0.476543495
0.476543495
0.476543495
0.476543495
0.476543495
0.476543495
0.381234796
0.381234796
0.381234796
0.381234796
0.381234796
0.381234796
0.381234796""")
panel_28 = Panel("""1
1
1
1
1
1
1
1
1
1
1
1
1
1
1
1
1
1
1
1
1
1
1
1""")
panel_29 = Panel("""0
0
0
0
0
0
0
0
0
0
0
0
0
0
0
0
0
0
0
0
0
0
0
0""")
panel_30 = Panel("""0
0
0
0
0
0.1
0.2
0.95
0.95
0.95
0.95
0.3
0.95
0.95
0.95
0.95
0.3
0.1
0.1
0.1
0.1
0.05
0.05
0.05""")
panel_31 = Panel("""0
0
0
0
0
0.1
0.1
0.3
0.3
0.3
0.3
0.1
0.1
0.1
0.1
0.1
0.05
0.05
0
0
0
0
0
0""")
panel_32 = Panel("""0
0
0
0
0
0
0
0
0
0
0
0
0
0
0
0
0
0
0
0
0
0
0
0""")

# ---- group: Window and Door Construction
windows = Geometry([<brep referenced from the Rhino model> x4])
aperture = HBAperture(geo=windows, name="Windows", operable=Toggle(True), ep_constr=decnstrconstrset.window)  # -> report, apertures; plug-in component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

# ----
weeklyschedule_3 = HBWeeklySchedule(
    sun=panel_26,
    mon=panel_27,
    tue=panel_27,
    wed=panel_27,
    thu=panel_27,
    fri=panel_27,
    sat=panel_20,
    holiday=panel_26,
    summer_des=panel_28,
    winter_des=panel_29,
    name="BLDG_EQUIP_SCH",
    type_limit="Fractional")  # -> report, schedule, idf_year, idf_week, idf_days; plug-in component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
weeklyschedule_4 = HBWeeklySchedule(
    sun=panel_21,
    mon=panel_30,
    tue=panel_30,
    wed=panel_30,
    thu=panel_30,
    fri=panel_30,
    sat=panel_31,
    holiday=panel_21,
    summer_des=panel_22,
    winter_des=panel_32,
    name="BLDG_OCC_SCH",
    type_limit="Fractional")  # -> report, schedule, idf_year, idf_week, idf_days; plug-in component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
weeklyschedule_5 = HBWeeklySchedule(
    sun=panel_23,
    mon=panel_18,
    tue=panel_18,
    wed=panel_18,
    thu=panel_18,
    fri=panel_18,
    sat=panel_19,
    holiday=panel_23,
    summer_des=panel_24,
    winter_des=panel_25,
    name="BLDG_LIGHT_SCH",
    type_limit="Fractional")  # -> report, schedule, idf_year, idf_week, idf_days; plug-in component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
panel_33 = Panel("""0
0
0
0
0
0
0.16
0.14
0.21
0.18
0.25
0.21
0.13
0.08
0.04
0.05
0.06
0
0
0
0
0
0
0""")
panel_34 = Panel("""0
0
0
0
0
0
0
0
0
0
0
0
0
0
0
0
0
0
0
0
0
0
0
0""")
panel_35 = Panel("""0
0
0
0
0
0
0.16
0.14
0.21
0.18
0.25
0.21
0.13
0.08
0.04
0.05
0.06
0
0
0
0
0
0
0""")
panel_36 = Panel("""0
0
0
0
0
0
0
0
0
0
0
0
0
0
0
0
0
0
0
0
0
0
0
0""")
panel_37 = Panel("""1
1
1
1
1
0.25
0.25
0.25
0.25
0.25
0.25
0.25
0.25
0.25
0.25
0.25
0.25
0.25
0.25
0.25
0.25
1
1
1""")
panel_38 = Panel("""0
0
0
0
0
0.144
1
0.144
0.144
0.144
0.144
1
0.144
0.144
0.144
0.144
1
0.144
0
0
0
0
0
0""")
panel_39 = Panel("""0
0
0
0
0
0
0
0
0
0
0
0
0
0
0
0
0
0
0
0
0
0
0
0""")
panel_40 = Panel("""0
0
0
0
0
0
0.35
0.69
0.43
0.37
0.43
0.58
0.48
0.37
0.37
0.46
0.62
0.12
0.04
0.04
0
0
0
0""")
panel_41 = Panel("""0.69
0.69
0.69
0.69
0.69
0.69
0.69
0.69
0.69
0.69
0.69
0.69
0.69
0.69
0.69
0.69
0.69
0.69
0.69
0.69
0.69
0.69
0.69
0.69""")
panel_42 = Panel("""0
0
0
0
0
0
0.35
0.69
0.43
0.37
0.43
0.58
0.48
0.37
0.37
0.46
0.62
0.12
0.04
0.04
0
0
0
0""")
panel_43 = Panel("""0.69
0.69
0.69
0.69
0.69
0.69
0.69
0.69
0.69
0.69
0.69
0.69
0.69
0.69
0.69
0.69
0.69
0.69
0.69
0.69
0.69
0.69
0.69
0.69""")
panel_44 = Panel("""1
1
1
1
1
1
1
1
1
1
1
1
1
1
1
1
1
1
1
1
1
1
1
1""")
weeklyschedule_6 = HBWeeklySchedule(
    sun=panel_38,
    mon=panel_39,
    tue=panel_39,
    wed=panel_39,
    thu=panel_39,
    fri=panel_39,
    sat=panel_38,
    holiday=panel_38,
    summer_des=panel_39,
    winter_des=panel_38,
    name="INFIL_Door_Opening_SCH",
    type_limit="Fractional")  # -> report, schedule, idf_year, idf_week, idf_days; plug-in component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
weeklyschedule_7 = HBWeeklySchedule(
    sun=panel_34,
    mon=panel_40,
    tue=panel_40,
    wed=panel_40,
    thu=panel_40,
    fri=panel_40,
    sat=panel_33,
    holiday=panel_34,
    summer_des=panel_41,
    winter_des=panel_34,
    name="BLDG_ELEVATORS",
    type_limit="Fractional")  # -> report, schedule, idf_year, idf_week, idf_days; plug-in component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
weeklyschedule_8 = HBWeeklySchedule(
    sun=panel_36,
    mon=panel_42,
    tue=panel_42,
    wed=panel_42,
    thu=panel_42,
    fri=panel_42,
    sat=panel_35,
    holiday=panel_36,
    summer_des=panel_43,
    winter_des=panel_36,
    name="ELEV_LIGHT_FAN_SCH_ADD_DF",
    type_limit="Fractional")  # -> report, schedule, idf_year, idf_week, idf_days; plug-in component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
weeklyschedule_9 = HBWeeklySchedule(
    sun=panel_44,
    mon=panel_37,
    tue=panel_37,
    wed=panel_37,
    thu=panel_37,
    fri=panel_37,
    sat=panel_44,
    holiday=panel_44,
    summer_des=panel_37,
    winter_des=panel_44,
    name="INFIL_SCH_PNNL",
    type_limit="Fractional")  # -> report, schedule, idf_year, idf_week, idf_days; plug-in component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
panel_45 = Panel("""0
0
0
0
0
0.04
0.04
0.04
0.04
0.04
0.06
0.06
0.09
0.06
0.04
0.04
0.04
0
0
0
0
0
0
0""")
panel_46 = Panel("""0
0
0
0
0
0.07
0.19
0.35
0.38
0.39
0.47
0.57
0.54
0.34
0.33
0.44
0.26
0.21
0.15
0.17
0.08
0.05
0.05
0.05""")
panel_47 = Panel("""0
0
0
0
0
0.07
0.11
0.15
0.21
0.19
0.23
0.2
0.19
0.15
0.13
0.14
0.14
0.07
0
0
0
0
0
0""")
versions_2 = HBCheckVersions()  # -> lbt_gh, python, radiance, openstudio, energyplus; plug-in component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
roomenergyattr = HBRoomEnergyAttributes({"Program": "properties.energy.program_type.display_name", "Construction Set": "properties.energy.construction_set.display_name", "Is Conditioned": "properties.energy.is_conditioned", "People per Area [ppl/m2]": "properties.energy.people.people_per_area", "Area per Person [m2/ppl]": "properties.energy.people.area_per_person", "Lighting per Area [W/m2]": "properties.energy.lighting.watts_per_area"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}, selected="Program")
panel_48 = Panel(versions_2.lbt_gh)
panel_49 = Panel(versions_2.openstudio)
weeklyschedule_10 = HBWeeklySchedule(
    sun=panel_45,
    mon=panel_46,
    tue=panel_46,
    wed=panel_46,
    thu=panel_46,
    fri=panel_46,
    sat=panel_47,
    holiday=panel_45,
    summer_des=panel_46,
    winter_des=panel_47,
    name="BLDG_SWH_SCH",
    type_limit="Fractional")  # -> report, schedule, idf_year, idf_week, idf_days; plug-in component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
toggle_3 = BooleanToggle(True)
panel_50 = Panel("""AFN Surface Venting Window or Door Opening Factor
Surface Inside Face Convection Heat Transfer Coefficient""")
simcontrol = HBSimulationControl(
    do_zone_sizing=toggle_3,
    do_system_sizing=toggle_3,
    do_plant_sizing=toggle_3,
    for_sizing_period=Toggle(False),
    for_run_period=toggle_3)  # -> sim_control; plug-in component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
shadowcalc = HBShadowCalculation(solar_dist="FullInteriorAndExterior", frequency="30", max_figures="15000")  # -> shadow_calc; plug-in component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
panel_51 = Panel("C:\Users\admin\masterwin\thermal\mea\CreateTypicalDOEBuildingFromModel")
toggle_4 = BooleanToggle(True)
ddy_2b_sv = FilePath("C:\Users\admin\masterwin\thermal\epw\USA_HI_Honolulu.Intl.AP.911820_TMY3\1A_custom.ddy")
epw_4b_sv = FilePath("C:\Users\admin\masterwin\thermal\epw\USA_HI_Honolulu.Intl.AP.911820_TMY3\USA_HI_Honolulu.Intl.AP.911820_TMY3.epw")
panel_52 = Panel(epw_4b_sv)
simoutput = HBSimulationOutput(
    zone_energy_use=toggle_4,
    hvac_energy_use=toggle_4,
    gains_and_losses=toggle_4,
    comfort_metrics=toggle_4,
    surface_temperature=toggle_4,
    surface_energy_flow=toggle_4)  # -> report, sim_output; plug-in component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
customoutput = HBCustomSimulationOutput(base_sim_output=simoutput.sim_output, output_names=panel_50)  # -> report, sim_output; plug-in component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
sizingpar = HBSizingParameter(ddy_file=ddy_2b_sv, heating_fac="1", cooling_fac="1")  # -> sizing; plug-in component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
toggle_5 = BooleanToggle(True)
toggle_6 = BooleanToggle(False)
simpar = HBSimulationParameter(output=customoutput.sim_output, timestep=6, sim_control=simcontrol, shadow_calc=shadowcalc, sizing=sizingpar)  # -> sim_par; plug-in component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
create_typical_doe_building_from_model = CreateTypicalDOEBuildingFromModel(
    measure_path=panel_51,
    template="90.1-2016",
    system_type="Inferred",
    swh_src="Inferred",
    add_constructions=toggle_6,
    add_space_type_loads=toggle_6,
    add_elevators=toggle_6,
    add_internal_mass=toggle_6,
    add_exterior_lights=toggle_5,
    add_swh=toggle_5,
    add_thermostat=toggle_6,
    add_hvac=toggle_6,
    add_refrigeration=toggle_6,
    remove_objects=toggle_5)  # -> report, measure; plug-in component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
panel_53 = Panel("3")  # disabled
panel_54 = Panel("2")  # disabled
panel_55 = Panel("1")  # disabled
analysisperiod = LBAnalysisPeriod(start_month=panel_53, start_day=panel_55, start_hour=0, end_month=panel_53, end_day=panel_54)  # -> period, hoys, dates; disabled; plug-in component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
importepw = LBImportEPW(epw_file=epw_4b_sv)  # -> location, dry_bulb_temperature, dew_point_temperature, relative_humidity, wind_speed, wind_direction, direct_normal_rad, diffuse_horizontal_rad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; disabled; plug-in component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
panel_56 = Panel("""Acoustic Tile
102.788
ITM-1
102.314""")
applyper = LBApplyAnalysisPeriod(data=importepw.dry_bulb_temperature, period=analysisperiod.period)  # -> simplify(data); disabled; plug-in component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
xdata = LBDeconstructData(data=applyper)  # -> header, flatten(values); disabled; plug-in component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
panel_57 = Panel(xdata.header)  # disabled
panel_58 = Panel(xdata.values)  # disabled

# ----
# HB-Typical Insulated Steel Framed Exterior Floor-R27
panel_59 = Panel("Typical Carpet pad")
searchmats_8 = HBSearchMaterials(keywords=panel_59)  # -> opaque_mats, window_mats; plug-in component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
searchmats_9 = HBSearchMaterials(keywords="CP02 Carpet Pad")  # -> flatten(opaque_mats), window_mats; plug-in component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
searchmats_10 = HBSearchMaterials(keywords="G01 13mm gypsum board")  # -> opaque_mats, window_mats; plug-in component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
searchmats_11 = HBSearchMaterials(keywords="Typical Carpet pad")  # -> flatten(opaque_mats), window_mats; plug-in component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
searchmats_12 = HBSearchMaterials(keywords="25mm Stucco")  # -> flatten(opaque_mats), window_mats; plug-in component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
searchmats_13 = HBSearchMaterials(keywords="5/8 in. Gypsum Board")  # -> flatten(opaque_mats), window_mats; plug-in component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
searchmats_14 = HBSearchMaterials(keywords="Metal Roof Surface")  # -> flatten(opaque_mats), window_mats; plug-in component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
searchmats_15 = HBSearchMaterials(keywords="F08 Metal Surface")  # -> flatten(opaque_mats), window_mats; plug-in component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
searchconstrs = HBSearchConstructions(keywords="U 0.38 SHGC 0.36 Simple Glazing")  # -> opaque_constrs, window_constrs, shade_constrs; plug-in component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
searchmats_16 = HBSearchMaterials(keywords="Roof Membrane")  # -> flatten(opaque_mats), window_mats; plug-in component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
list_item_2 = ListItem(List=searchmats_14.opaque_mats, Index=0, Wrap=True)
merge = Merge(Data1=opaquematnomass, Data2=searchmats_3.opaque_mats, Data3=searchmats_11.opaque_mats)
merge_2 = Merge(Data1=searchmats_10.opaque_mats, Data2=searchmats_10.opaque_mats)
merge_3 = Merge(Data1=opaquemat_2, Data2=searchmats_9.opaque_mats)
merge_4 = Merge(Data1=searchmats_9.opaque_mats, Data2=opaquemat_2)
merge_5 = Merge(Data1=searchmats.opaque_mats, Data2=searchmats_8.opaque_mats)
merge_6 = Merge(
    Data1=searchmats_12.opaque_mats,
    Data2=searchmats_13.opaque_mats,
    Data3=opaquematnomass_3,
    Data4=searchmats_13.opaque_mats)
merge_7 = Merge(Data1=searchmats_15.opaque_mats, Data2=opaquematnomass_2)
opaqueconstr_2 = HBOpaqueConstruction(name="Typical Interior Wall", materials=merge_2)  # -> constr; plug-in component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
opaqueconstr_3 = HBOpaqueConstruction(name="Typical Interior Floor", materials=merge_4)  # -> constr; plug-in component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
opaqueconstr_4 = HBOpaqueConstruction(name="Typical Interior Ceiling", materials=merge_3)  # -> constr; plug-in component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
opaqueconstr_5 = HBOpaqueConstruction(name="Typical Insulated Carpeted 8in", materials=merge_5)  # -> constr; plug-in component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
opaqueconstr_6 = HBOpaqueConstruction(name="DOE-Typical Insulated Exterior Mass", materials=merge)  # -> constr; plug-in component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
opaqueconstr_7 = HBOpaqueConstruction(name="Typical Insulated Steel Framed Exterior Wall R-15.63", materials=merge_6)  # -> constr; plug-in component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
opaqueconstr_8 = HBOpaqueConstruction(name="Typical Insulated Metal Door", materials=merge_7)  # -> constr; plug-in component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
groundsubset = HBGroundConstructionSubset(ground_floor=opaqueconstr_5)  # -> ground_set; plug-in component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

list_item_3 = ListItem(List=searchconstrs.window_constrs, Index=2, Wrap=True)  # -> flatten(Item)
list_item_4 = ListItem(List=searchmats_16.opaque_mats, Index=1, Wrap=True)

# ---- group: 90.1-2016 - MedOffice - Plenum - ASHRAE 169-2013-2B
opaqueconstr_9 = HBOpaqueConstruction(name="flat Concrete Extrusions", materials=opaquemat)  # -> constr; plug-in component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
interiorsubset = HBInteriorConstructionSubset(ceiling=opaqueconstr_4, interior_floor=opaqueconstr_9)  # -> interior_set; plug-in component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

# ----
merge_8 = Merge(Data1=list_item_4, Data2=opaquematnomass_4, Data3=list_item_2)
opaqueconstr_10 = HBOpaqueConstruction(name="Typical IEAD Roof R-31.25", materials=merge_8)  # -> constr; plug-in component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
interiorsubset_2 = HBInteriorConstructionSubset(interior_wall=opaqueconstr_2, ceiling=opaqueconstr_9, interior_floor=opaqueconstr_3)  # -> interior_set; plug-in component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
subfacesubset = HBSubfaceSubset(window=list_item_3, operable=list_item_3, exterior_door=opaqueconstr_8)  # -> subface_set; plug-in component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
exteriorsubset = HBExteriorConstructionSubset(exterior_wall=opaqueconstr_7, exterior_roof=opaqueconstr_10, exposed_floor=opaqueconstr_6)  # -> exterior_set; plug-in component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
constructionset = HBConstructionSet(
    exterior_subset=exteriorsubset,
    ground_subset=groundsubset,
    interior_subset=interiorsubset_2,
    subface_subset=subfacesubset)  # -> constr_set; plug-in component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

# ---- group: 90.1-2016 - MedOffice - Plenum - ASHRAE 169-2013-2B (continued)
constructionset_2 = HBConstructionSet(exterior_subset=exteriorsubset, interior_subset=interiorsubset)  # -> constr_set; plug-in component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

# ---- group: Rooms
panel_60 = Panel("""office_md_perimeterRms1
office_md_perimeterRms2
office_md_perimeterRms3
office_md_perimeterRms4
office_md_core5""")
room = HBRoom(faces=replace_2, name=graft(panel_60), constr_set=constructionset, conditioned=Toggle(True))  # -> report, room; plug-in component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

# ---- group: Plenum
room_2 = HBRoom(faces=flatten(replace), name="Plenum", constr_set=constructionset_2, program=programtype, conditioned=Toggle(False))  # -> report, room; plug-in component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

# ----
roomattr_2 = HBRoomAttributes({"Display Name": "display_name", "Simulation Name (Identifier)": "identifier", "Multiplier": "multiplier", "Story": "story", "Volume": "volume", "Gross Floor Area": "floor_area", "Exposed Area": "exposed_area", "Exterior Wall Area": "exterior_wall_area", "Exterior Aperture Area": "exterior_aperture_area", "Average Floor Elevation": "average_floor_height"}, selected="Gross Floor Area")
roomsbyattr = HBRoomsByAttribute(rooms=graft(room.room), attribute=roomattr_2)  # -> values, rooms; plug-in component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
roomsbyattr_2 = HBRoomsByAttribute(rooms=graft(room_2.room), attribute=roomattr_2)  # -> values, rooms; plug-in component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

# ---- group: Internal Mass Definition
srf_area_per_flr_space_area = Panel("2")
flatten = FlattenTree(Tree=roomsbyattr_2.values, Path="{0}")
multiplication = Multiplication(A=flatten, B=srf_area_per_flr_space_area)
internalmass = HBInternalMass(rooms=room_2.room, geo_or_area=multiplication, construction=opaqueconstr, name="Internal Mass Definition 1")  # -> report, rooms; plug-in component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

# ----
panel_61 = Panel(room_2.room)

# ---- group: Ideal HVAC
idealair = HBIdealAir(rooms=flatten(room.room), economizer="NoEconomizer", sensible_hr="0", heat_limit="NoLimit", cool_limit="NoLimit")  # -> report, rooms; plug-in component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

# ---- group: Plenum Rooms
toggle_7 = BooleanToggle(False)
plenum = HBPlenum(rooms=internalmass.rooms, conditioned=Toggle(False), remove_infilt=toggle_7, include_floor=toggle_7)  # -> rooms; plug-in component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
graft = GraftTree(Tree=plenum, IncludeEmptyLists=True, IncludeNullItems=True)  # -> simplify(Tree)

# ----
labelrooms = HBLabelRooms(rooms_model=flatten(room.room), attribute=roomattr)  # -> label_text, base_pts, labels, wire_frame; plug-in component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
panel_62 = Panel(labelrooms.label_text)

# ---- group: Perimeter Rooms
cull_i = CullIndex(List=idealair.rooms, Indices="4", Wrap=True)
applyprogram = HBApplyProgramType(rooms=cull_i, program=programtype_2)  # -> report, simplify(rooms); plug-in component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

# ---- group: Cores
item_6 = ListItem(List=idealair.rooms, Index="4", Wrap=True)
applyprogram_2 = HBApplyProgramType(rooms=item_6, program=programtype_3)  # -> report, rooms; plug-in component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

# ----
ins_2 = InsertItems(List=applyprogram.rooms, Item=applyprogram_2.rooms, Indices="4", Wrap=True)

# ---- group: Rooms Per Level
solveadj = HBSolveAdjacency(rooms=ins_2, adiabatic=Toggle(False), run=Toggle(True))  # -> report, simplify(adj_rooms); plug-in component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

# ---- group: Internal Mass Definition
flatten_2 = FlattenTree(Tree=roomsbyattr.values, Path="{0}")
srf_area_per_flr_space_area_2 = Panel("2")
path_mapper = PathMapper(flatten_2, source="{A}(i)", target="{i\5}")
multiplication_2 = Multiplication(A=path_mapper, B=srf_area_per_flr_space_area_2)
internalmass_2 = HBInternalMass(rooms=solveadj.adj_rooms, geo_or_area=multiplication_2, construction=opaqueconstr, name="Internal Mass Definition 1")  # -> report, simplify(rooms); plug-in component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

# ----
merge_9 = Merge(Data1=graft, Data2=internalmass_2.rooms)

# ---- group: Plenum to Room per Level
solveadj_2 = HBSolveAdjacency(rooms=merge_9, adiabatic=Toggle(False), run=Toggle(True))  # -> report, simplify(adj_rooms); plug-in component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

# ----
panel_63 = Panel(solveadj_2.adj_rooms)
addsubface = HBAddSubface(hb_obj=flatten(solveadj_2.adj_rooms), sub_faces=flatten(aperture.apertures))  # -> hb_obj; plug-in component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

# ---- group: Nat. Vent.
panel_64 = Panel("28")
panel_65 = Panel("21")
ventcontrol = HBVentilationControl(min_in_temp="23", max_in_temp="28")  # -> vent_cntrl; plug-in component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
applysetpointvals = HBApplySetpointValues(room_or_program=flatten(addsubface), cooling_setpt="29", heating_setpt="20")  # -> report, mod_obj; plug-in component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
windowopen = HBWindowOpening(rooms=flatten(applysetpointvals.mod_obj), vent_cntrl=ventcontrol, wind_cross_vent=Toggle(False))  # -> report, rooms; plug-in component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

# ----
panel_66 = Panel(addsubface)
labelrooms_2 = HBLabelRooms(rooms_model=flatten(windowopen.rooms), attribute=roomenergyattr)  # -> label_text, base_pts, labels, wire_frame; plug-in component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
vizbytype = HBVisualizeByType(hb_objs=windowopen.rooms)  # -> walls, interior_walls, roofs, ceilings, exterior_floors, interior_floors, air_walls, apertures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; plug-in component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
vizbybc = HBVisualizeByBC(hb_objs=windowopen.rooms)  # -> outdoors, surface, ground, adiabatic, other, wire_frame; plug-in component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
model = HBModel(rooms=flatten(windowopen.rooms), name="DOEPrototype_1A_L1_itm")  # -> report, model; plug-in component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
geo = Geometry(vizbybc.adiabatic)
geo_2 = Geometry(vizbytype.interior_walls)
geo_3 = Geometry(vizbytype.ceilings)
geo_4 = Geometry(vizbytype.interior_floors)
geo_5 = Geometry(vizbytype.apertures)
geo_6 = Geometry(vizbytype.wire_frame)
panel_67 = Panel(labelrooms_2.label_text)
afn = HBAirflowNewtwork(model=model.model)  # -> report, model; plug-in component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
modeltoosm = HBModelToOSM(
    model=afn.model,
    epw_file=epw_4b_sv,
    sim_par=simpar,
    folder="C:\Users\admin\masterwin\thermal\sim_",
    write=Toggle(False),
    run="2")  # -> report, jsons, osw, osm, idf, sql, zsz, rdd, html; plug-in component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
swaposm = SwapOSM(
    osm=modeltoosm.osm,
    epw=epw_4b_sv,
    mea=create_typical_doe_building_from_model.measure,
    run_swap=Toggle(True),
    run_sim=Toggle(False),
    update=Toggle(False))  # -> out, osm, osm_swap, idf, sql, zsz, rdd, html, err; inputs mea: list
# ---------- swaposm: Python ----------
"""Run swap.py from subprocess on LBT python."""
from __future__ import print_function
import sys
import os
import json
from pprint import pprint
from subprocess import Popen, PIPE, STDOUT
from honeybee.config import folders as hb_config
from honeybee_energy.config import folders as hbe_config
from honeybee_energy.measure import Measure
from ladybug_rhino.download import download_file


# Global
path = os.path
SWAP_URL = "https://raw.githubusercontent.com/saeranv/thermal/main/lbt/swap.py"
SWAP_NAME = "swap.py"
IS_TTY = sys.stdin.isatty() or len(sys.argv) > 1


def run_subproc(cmds):
    """Run subprocess for list of commands (cmds)."""

    print("Running command:\n{}\n".format(" ".join(cmds)))
    p = Popen(cmds, shell=True, stdout=PIPE, stderr=PIPE)
    _stdout, _stderr = p.communicate()

    assert p.returncode == 0, \
        "stdout:\n{}\nstderr:\n{}".format(_stdout, _stderr)
    return _stdout, _stderr


def update_swap(_swap_fpath):
    """Update swap.py from github and confirm in lbt scripts path."""

    _ = download_file(SWAP_URL, _swap_fpath)
    print("## Downloaded {} from {}.".format(SWAP_NAME, SWAP_URL))

    assert path.exists(_swap_fpath), \
        "Path {} not exist.\n".format(_swap_fpath)


def update_pip(_lbt_pytexe, _ops_version):
    """Update openstudio SDK via pip."""

    # Check if pip opesntudio is updated
    cmds = [_lbt_pytexe, "-m", "pip", "list"]
    _stdout = run_subproc(cmds)[0]
    pkgs = _stdout.decode("utf-8").strip().split("\n")
    is_pip_match = False
    for pkg in pkgs:
        if "openstudio" in pkg:
            _ops_version_ = pkg.split("openstudio")[1].strip()
            print("## Found openstudio {} in pip.".format(_ops_version_))
            is_pip_match = _ops_version_ == _ops_version
            break

    if not is_pip_match:
        # Pip install openstudio if not in pip or version wrong
        _ops_pkg = "openstudio=={}".format(_ops_version)
        cmds = [_lbt_pytexe, "-m", "pip", "install", _ops_pkg]

        _stdout, _stderr = run_subproc(cmds)
        if _stdout: print(_stdout.decode("utf-8").strip())
        if _stderr: print(_stderr.decode("utf-8").strip())


def dump_mea(measure, osm_fpath):
    """Dump measure to osw file."""

    osw_fpath = path.join(path.dirname(osm_fpath), "workflow.osw")
    osw_dict = measure.to_osw_dict()
    osw_dict["measure_paths"] = [measure.folder]
    with open(osw_fpath, "w") as fp:
        json.dump(osw_dict, fp, indent=4)
    return osw_fpath

if IS_TTY:
    # Label bool, fpath inputs
    run_swap_, run_sim_, update_ = True, True, True
    _osm, _epw, _mea_dpath = sys.argv[-3:]
    mea = Measure(_mea_dpath)

if run_swap_ or run_sim_ or update_:

    # # Overwrite
    # update_ = False
    # run_swap_ = False
    # run_sim_ = False
    _osw_swap, _osm_swap = None, None
    swap_fpath = path.join(hb_config.python_scripts_path, SWAP_NAME)
    lbt_pytexe = hb_config.python_exe_path
    lbt_opsexe = hbe_config.openstudio_exe
    opsv_ = hbe_config.openstudio_version
    ops_version = "{}.{}.{}".format(opsv_[0], opsv_[1], opsv_[2])
    runsim_dpath = path.join(path.dirname(_osm), "run") # sim dpath is child
    # # TODO: only for debugging
    # swap_fpath = path.abspath(path.join(_epw, "../../../lbt", SWAP_NAME))

    # Update/confirm swap_fpath exists
    if update_ or (not path.exists(swap_fpath)):
        _ = update_swap(swap_fpath)
        _ = update_pip(lbt_pytexe, ops_version)

    if run_swap_:
        # Run swap
        print("\n## Running swap.py on lbtpyt.exe")

        # Update measure, and run swap_win.py
        _osw = dump_mea(_mea[0], _osm)
        swap_cmds = [lbt_pytexe, swap_fpath, _osw, _osm, _epw]
        stdout, stderr = run_subproc(swap_cmds)
        _osm_swap, _osw_swap = \
            stdout.decode('utf-8').strip().split("\n")[-2:]
        if stdout: print(stdout.decode('utf-8'))
        if stderr: print(stderr.decode('utf-8'))

    if run_sim_:
        # Run workflow.osw
        print("\n## Running workflow.osw on openstudio.exe")

        if not _osw_swap:
            _osw_swap = path.join(runsim_dpath, "workflow_swap.osw")

        assert path.exists(_osw_swap), \
            "OSW not found at {}".format(_osw_swap)

        sim_cmds = [lbt_opsexe, "run", "-w", _osw_swap]
        stdout, stderr = run_subproc(sim_cmds)
        if stdout: print(stdout)
        if stderr: print(stderr)

        # Get outputs
        # print(runsim_dpath, ":\n", os.listdir(runsim_dpath))
        _sql = path.join(runsim_dpath, "eplusout.sql")
        _err = path.join(runsim_dpath, "eplusout.err")
        if path.exists(_sql):
            osm = path.join(runsim_dpath, "in.osm")
            idf = path.join(runsim_dpath, "in.idf")
            zsz = path.join(runsim_dpath, "epluszsz.csv")
            rdd = path.join(runsim_dpath, "eplus.rdd")
            html = path.join(runsim_dpath, "eplustbl.htm")
            sql = _sql
            print(osm, idf, zsz, rdd, html, err, sql, sep="\n")
        if path.exists(_err):
            err = _err
# ---------- end swaposm ----------
faceresult = HBReadFaceResult(sql=swaposm.sql)  # -> face_indoor_temp, face_outdoor_temp, face_energy_flow; disabled; plug-in component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
customresult = HBReadCustomResult(sql=swaposm.sql, output_names=panel_50)  # -> results; disabled; plug-in component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
roomenergyresult = HBReadRoomEnergyResult(sql=swaposm.sql)  # -> cooling, heating, lighting, electric_equip, gas_equip, process, hot_water, fan_electric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; disabled; plug-in component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
roomcomfortresult = HBReadRoomComfortResult(sql=swaposm.sql)  # -> oper_temp, air_temp, rad_temp, rel_humidity; disabled; plug-in component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
bang = ExplodeTree(Data=simplify(customresult))  # -> Branch0, Branch1; disabled
eui = HBEndUseIntensity(sql=swaposm.sql)  # -> eui, eui_end_use, end_uses, gross_floor; plug-in component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
panel_68 = Panel(swaposm.osm)
panel_69 = Panel(swaposm.osm_swap)
applyper_2 = LBApplyAnalysisPeriod(data=roomcomfortresult.air_temp, period=analysisperiod.period)  # -> simplify(data); disabled; plug-in component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
applyper_3 = LBApplyAnalysisPeriod(data=bang.Branch1, period=analysisperiod.period)  # -> simplify(data); disabled; plug-in component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
applyper_4 = LBApplyAnalysisPeriod(data=faceresult.face_indoor_temp, period=analysisperiod.period)  # -> simplify(data); disabled; plug-in component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
panel_70 = Panel(eui.eui)
panel_71 = Panel(eui.end_uses)
faceresultbytype = HBFaceResultByType(data=applyper_4, hb_objs=windowopen.rooms)  # -> walls, interior_walls, roofs, ceilings, exterior_floors, interior_floors, apertures, interior_apertures, doors, interior_doors; disabled; plug-in component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
panel_72 = Panel(swaposm.out)
faceresultbytype_2 = HBFaceResultByType(data=applyper_3, hb_objs=windowopen.rooms)  # -> walls, interior_walls, roofs, ceilings, exterior_floors, interior_floors, apertures, interior_apertures, doors, interior_doors; disabled; plug-in component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
bang_2 = ExplodeTree(Data=simplify(graft(applyper_2)))  # -> Branch0, Branch1, Branch2, Branch3, Branch4, Branch5; disabled
xdata_2 = LBDeconstructData(data=bang_2.Branch3)  # -> header, flatten(values); disabled; plug-in component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
panel_73 = Panel(eui.eui_end_use)
bang_3 = ExplodeTree(Data=simplify(graft(faceresultbytype.ceilings)))  # -> Branch0, Branch1, Branch2, Branch3; disabled
bang_4 = ExplodeTree(Data=simplify(graft(faceresultbytype_2.ceilings)))  # -> Branch0, Branch1, Branch2, Branch3; disabled
panel_74 = Panel(xdata_2.header)  # disabled
panel_75 = Panel(xdata_2.values)  # disabled
graph = QuickGraph([xdata.values, xdata_2.values], SortOrder=0)  # disabled
xdata_3 = LBDeconstructData(data=bang_3.Branch3)  # -> header, values; disabled; plug-in component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
panel_76 = Panel(xdata_3.header)  # disabled
xdata_4 = LBDeconstructData(data=faceresultbytype_2.ceilings)  # -> header, values; disabled; plug-in component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
xdata_5 = LBDeconstructData(data=bang_4.Branch0)  # -> header, values; disabled; plug-in component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
xdata_6 = LBDeconstructData(data=bang_4.Branch1)  # -> header, values; disabled; plug-in component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
xdata_7 = LBDeconstructData(data=bang_4.Branch2)  # -> header, values; disabled; plug-in component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
xdata_8 = LBDeconstructData(data=bang_4.Branch3)  # -> header, values; disabled; plug-in component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
merge_10 = Merge(Data1=xdata_3.values, Data2=xdata_2.values)  # disabled
panel_77 = Panel(xdata_4.header)  # disabled
sort = SortList(Keys=flatten([xdata_5.values, xdata_6.values, xdata_7.values, xdata_8.values]))  # -> Keys, ValuesA; disabled
graph_2 = QuickGraph(merge_10, SortOrder=0)  # disabled
avr = Average(Input=sort.Keys)  # disabled
bar_graph = BarGraph(sort.Keys, BarColor=RGB(255, 0, 90))  # disabled
panel_78 = Panel(avr)  # disabled
graph_3 = QuickGraph(xdata_5.values, SortOrder=0)  # disabled
rev = ReverseList(List=sort.Keys)  # disabled
panel_79 = Panel(rev)  # disabled
