# Grasshopper definition swap_osm.gh (Grasshopper 1.0.7)

toggle = BooleanToggle(False)
panel = Panel("C:\Users\admin\masterwin\thermal\mea\CreateTypicalDOEBuildingFromModel")

# ----
# Update to LBT 1.6.0 (or greater)
# 1. Generate OSM w/ HB Model to OSM
# 2. _update: to update script
# 3. _run_swap to create new OSM
# 4. _run_sim to simulate, get SQL
toggle_2 = BooleanToggle(False)
versions = HBCheckVersions()  # -> lbt_gh, python, radiance, openstudio, energyplus; plug-in component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
panel_2 = Panel(versions.lbt_gh)
panel_3 = Panel(versions.openstudio)
versioner = LBVersioner(update=Toggle(False), version="1.6.0")  # -> Vviiiiiz; plug-in component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
syncghfile = LBSyncGrasshopperFile(sync=toggle_2)  # -> report; plug-in component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
panel_4 = Panel(syncghfile)

create_typical_doe_building_from_model = CreateTypicalDOEBuildingFromModel(
    measure_path=panel,
    template="90.1-2016",
    system_type="Inferred",
    swh_src="Inferred",
    add_constructions=toggle,
    add_elevators=toggle,
    add_exterior_lights=Toggle(True),
    add_hvac=Toggle(False))  # -> report, measure; plug-in component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
panel_5 = Panel("C:\Users\admin\masterwin\thermal\epw\USA_HI_Honolulu.Intl.AP.911820_TMY3\USA_HI_Honolulu.Intl.AP.911820_TMY3.epw")
toggle_3 = BooleanToggle(False)
swaposm = SwapOSM(
    osm="C:\Users\admin\masterwin\thermal\simops\run\in.osm",
    epw=panel_5,
    mea=create_typical_doe_building_from_model.measure,
    run_swap=toggle_3,
    run_sim=toggle_3,
    update=Toggle(False))  # -> out, osm, osm_swap, idf, sql, zsz, rdd, html, err; inputs mea: list
# ---------- swaposm: Python ----------
"""Run swap.py from subprocess on LBT python."""
from __future__ import print_function
import sys
import os
import json
from pprint import pprint
from subprocess import Popen, PIPE, STDOUT
from honeybee.config import folders as hb_config
from honeybee_energy.config import folders as hbe_config
from honeybee_energy.measure import Measure
from ladybug_rhino.download import download_file


# Global
path = os.path
SWAP_URL = "https://raw.githubusercontent.com/saeranv/thermal/main/lbt/swap.py"
SWAP_NAME = "swap.py"
IS_TTY = sys.stdin.isatty() or len(sys.argv) > 1


def run_subproc(cmds):
    """Run subprocess for list of commands (cmds)."""

    print("Running command:\n{}\n".format(" ".join(cmds)))
    p = Popen(cmds, shell=True, stdout=PIPE, stderr=PIPE)
    _stdout, _stderr = p.communicate()

    assert p.returncode == 0, \
        "returncode: {}\nstdout:\n{}\nstderr:\n{}".format(
            p.returncode, _stdout, _stderr)
    return _stdout, _stderr


def update_swap(_swap_fpath):
    """Update swap.py from github and confirm in lbt scripts path."""

    _ = download_file(SWAP_URL, _swap_fpath)
    print("## Downloaded {} from {}.".format(SWAP_NAME, SWAP_URL))

    assert path.exists(_swap_fpath), \
        "Path {} not exist.\n".format(_swap_fpath)


def update_pip(_lbt_pytexe, _ops_version):
    """Update openstudio SDK via pip."""

    # Check if pip opesntudio is updated
    cmds = [_lbt_pytexe, "-m", "pip", "list"]
    _stdout = run_subproc(cmds)[0]
    pkgs = _stdout.decode("utf-8").strip().split("\n")
    is_pip_match = False
    for pkg in pkgs:
        if "openstudio" in pkg:
            _ops_version_ = pkg.split("openstudio")[1].strip()
            print("## Found openstudio {} in pip.".format(_ops_version_))
            is_pip_match = _ops_version_ == _ops_version
            break

    if not is_pip_match:
        # Pip install openstudio if not in pip or version wrong
        _ops_pkg = "openstudio=={}".format(_ops_version)
        cmds = [_lbt_pytexe, "-m", "pip", "install", _ops_pkg]

        _stdout, _stderr = run_subproc(cmds)
        if _stdout: print(_stdout.decode("utf-8").strip())
        if _stderr: print(_stderr.decode("utf-8").strip())


def dump_mea(measure, osw_fpath):
    """Dump measure to osw file."""

    osw_dict = measure.to_osw_dict()
    osw_dict["measure_paths"] = [measure.folder]
    with open(osw_fpath, "w") as fp:
        json.dump(osw_dict, fp, indent=4)
    return osw_fpath

if IS_TTY:
    # Label bool, fpath inputs
    run_swap_, run_sim_, update_ = True, True, True
    _osm, _epw, _mea_dpath = sys.argv[-3:]
    _mea = Measure(_mea_dpath)

if run_swap_ or run_sim_ or update_:

    # # Overwrite
    # update_ = False
    # run_swap_ = False
    # run_sim_ = False
    _osw_swap, _osm_swap = None, None
    lbt_pytexe = hb_config.python_exe_path
    lbt_opsexe = hbe_config.openstudio_exe
    opsv_ = hbe_config.openstudio_version
    ops_version = "{}.{}.{}".format(opsv_[0], opsv_[1], opsv_[2])
    runsim_dpath = path.dirname(_osm) # sim dpath is child
    _osw = path.join(runsim_dpath, "workflow.osw")

    # # TODO: only for debugging
    swap_fpath = path.join(hb_config.python_scripts_path, SWAP_NAME)
    # swap_fpath = path.abspath(path.join(_epw, "../../../lbt", SWAP_NAME))

    # Update/confirm swap_fpath exists
    if update_ or (not path.exists(swap_fpath)):
        _ = update_swap(swap_fpath)
        _ = update_pip(lbt_pytexe, ops_version)
        update_cmds = [lbt_pytexe, swap_fpath, "--help"]
        stdout = run_subproc(update_cmds)[0]
        print(stdout.decode("utf-8").strip())

    if run_swap_:
        # Run swap
        print("\n## Running swap.py on lbtpyt.exe")
        # Update measure, and run swap_win.py
        _osw = dump_mea(_mea[0], _osw)
        swap_cmds = [lbt_pytexe, swap_fpath, _osw, _osm, _epw]
        stdout, stderr = run_subproc(swap_cmds)
        _osm_swap, _osw_swap = \
            stdout.decode('utf-8').strip().split("\n")[-2:]
        if stdout: print(stdout.decode('utf-8'))
        if stderr: print(stderr.decode('utf-8'))

    if run_sim_:
        # Run workflow.osw
        print("\n## Running workflow.osw on openstudio.exe")

        if not _osw_swap:
            _osw_swap = path.join(runsim_dpath, "workflow_swap.osw")

        assert path.exists(_osw_swap), \
            "OSW not found at {}".format(_osw_swap)

        sim_cmds = [lbt_opsexe, "run", "-w", _osw_swap]
        stdout, stderr = run_subproc(sim_cmds)
        if stdout: print(stdout)
        if stderr: print(stderr)

        # Get outputs
        # print(runsim_dpath, ":\n", os.listdir(runsim_dpath))

        ransim_dpath = path.join(runsim_dpath, "run")
        _sql = path.join(ransim_dpath, "eplusout.sql")
        if path.exists(_sql):
            osm = path.join(ransim_dpath, "in.osm")
            idf = path.join(ransim_dpath, "in.idf")
            zsz = path.join(ransim_dpath, "epluszsz.csv")
            rdd = path.join(ransim_dpath, "eplus.rdd")
            html = path.join(ransim_dpath, "eplustbl.htm")
            err = path.join(ransim_dpath, "eplusout.err")
            sql = _sql
            print(osm, idf, zsz, rdd, html, err, sql, sep="\n")
# ---------- end swaposm ----------
eui = HBEndUseIntensity(sql=swaposm.sql)  # -> eui, eui_end_use, end_uses, gross_floor; plug-in component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
